# Grasshopper definition Components bookWorm.gh (Grasshopper 1.0.7)
# plug-ins: Bookworm

number_slider = Slider(15, range=0..100)
toggle = BooleanToggle(True)
concellborder = ConstructCellBorder(BorderStyle="2", Color=ColourSwatch(SwatchColor=RGB(255, 242, 0)))
toggle_2 = BooleanToggle(True)
concellborders = ConstructCellBorders(BorderTop=concellborder)
conpadding = ConstructPadding(Top="25")
swatch = ColourSwatch(SwatchColor=RGB(146, 189, 4))
contextrotation = ConstructTextRotation(Angle=Slider(0, range=-90..90), Vertical=Toggle(False))
contextformat = ConstructTextFormat(
    ForegroundColour=ColourSwatch(SwatchColor=RGB(196, 0, 255)),
    FontFamily="Verdana",
    Bold=toggle,
    Italic=toggle,
    Strikethrought=toggle,
    Underline=toggle)
panel = Panel(contextformat)
connumberformat = ConstructNumberFormat(NumberFormatType="1")
panel_2 = Panel(ColourSwatch(SwatchColor=RGB(242, 205, 94)))
panel_3 = Panel(swatch)
number_slider_2 = Slider(500, range=0..1000)
panel_4 = Panel("""Количество комнат
Евро
Студия""")
number_slider_3 = Slider(2, range=0..10)
conextendedvalue = ConstructExtendedValue(Value=panel_4)
concellformat = ConstructCellFormat(
    NumberFormat=connumberformat,
    BackgroundColour=swatch,
    Borders=concellborders,
    Padding=conpadding,
    TextFormat=contextformat,
    TextRotation=contextrotation)
panel_5 = Panel("136sKKVnzYGOcDbLzDCTKq6zVEHlm_2nUyYPIjH6f-F4")
panel_6 = Panel(concellformat)
concell = ConstructCell(UserEnteredValue=conextendedvalue, CellFormat=concellformat)
readcell = ReadCell(
    SpreadsheetURL="1A4-OZONXYfRZbBfHRNpN6nU8IgeaBQi29x4bGgja-Aw",
    SheetName="ns gbkjh",
    CellRange="A1:n19",
    Read=Toggle(False),
    SameLength=False)
readcell_2 = ReadCell(SpreadsheetURL=panel_5, SheetName="Квартирография_1", CellRange="A1:B2", Read=Toggle(True), SameLength=False)  # disabled
merge = Merge(Data1=concell, Data2=concell)
decell = DeconstructCell(Cell=readcell_2)  # -> FormattedValue, UserEnteredValue, CellFormat
writecell = WriteCells(SpreadsheetURL=panel_5, SheetName="Квартирография_1", CellRange="J1:J4", Cells=concell, Run=Button())
panel_7 = Panel(readcell_2)
concell_2 = ConstructCell(UserEnteredValue=decell.UserEnteredValue, CellFormat=decell.CellFormat)  # -> flatten(Cell)
panel_8 = Panel("1A4-OZONXYfRZbBfHRNpN6nU8IgeaBQi29x4bGgja-Aw")
panel_9 = Panel("brandnew")
panel_10 = Panel("A1:B2")
cull_i = CullIndex(List=concell_2, Indices="3", Wrap=True)
nickname = MergeCells(SpreadsheetURL=panel_8, SheetName="ns gbkjh", CellRange="G1:h2", MergeType="2", Run=Toggle(False))
item = ListItem(List=cull_i, Index=0, Wrap=True)
merge_2 = Merge(Data1=cull_i, Data2=item)  # -> flatten(Result)
panel_11 = Panel(merge_2)
nickname_2 = UnmergeCells(SpreadsheetURL=panel_8, SheetName="ns gbkjh", CellRange="G1:h2", Run=Toggle(False))
writecell_2 = WriteCells(SpreadsheetURL=panel_8, SheetName="ns gbkjh", CellRange="18:19", Cells=merge, Run=Toggle(True))
item_2 = ListItem(List=merge_2, Index="2", Wrap=True)
